# Grasshopper definition twisted-tower.gh (Grasshopper 1.0.8)

radius = Slider(12, range=4..30)
floors = Slider(24, range=2..60)
floor_h = Slider(3.2, range=2.5..5)
sides = Slider(6, range=3..12)
polygon = Polygon(Plane=PlaneXY(0, 0, 0), Radius=radius, Segments=sides, FilletRadius=0)  # -> Polygon, Length
series = Series(Start=0, Step=floor_h, Count=floors)
twist = Slider(0.02, range=0..0.1)
Z = UnitZ(Factor=series)
divisions = Slider(16, range=4..40)
multiplication = Multiplication(A=series, B=twist)
move = Move(Geometry=polygon.Polygon, Motion=Z)  # -> Geometry, Transform
rotate = Rotate(Geometry=move.Geometry, Angle=multiplication, Plane=PlaneXY(0, 0, 0))  # -> Geometry, Transform
divide = DivideCurve(Curve=rotate.Geometry, Count=divisions, Kinks=False)  # -> Points, Tangents, Parameters
loft = Loft(Curves=rotate.Geometry, Options={Adjust=False, Closed=False, LoftEnds=0, LoftSimp=0, LoftType=0, Rebuild=10, Refit=0.01})
flip = FlipMatrix(Data=divide.Points)
intcrv = Interpolate(Vertices=flip, Degree=3, Periodic=False, KnotStyle=1)  # -> Curve, Length, Domain
area = Area(Geometry=loft)  # -> Area, Centroid
panel = Panel(area.Area)
